test file "Simulink_TestManager"
  coverage: Decision, MCDC, Condition

suite "New Test Suite 1"

  case "New Test Case 1" [baseline]
    model Example
    parameter set "Test_Param.m":
      Aps_val1 = 60  % base workspace
      Aps_val2 = 40  % base workspace
      Aps_val3 = 20  % base workspace
      Default_Value = 5  % base workspace
      Gear_Val1 = 4  % base workspace
      Gear_Val2 = 3  % base workspace
      Gear_Val3 = 2  % base workspace
      Gear_Val4 = 1  % base workspace
      vsp_val = 50  % base workspace
    input "Test_Input2.mat", mapped to enable, IOINs_Aps, vsp (active)
    logged signals "Signal Set 1": tgtGear
    baseline "Test_Baseline.mat"
      tgtGear